# Grasshopper definition example2.ghx (Grasshopper 0.9.76)

W = Data()
X = Data()
multiplication = Multiplication(A=W, B=X)
Y = Data()
addition = Addition(A=multiplication, B=Y)
sqr = Square(Value=addition)
Z = Data(sqr)
